# Grasshopper definition example01.ghx (Grasshopper 1.0.7)
# plug-ins: Kangaroo2 Components, Anemone

reload = Button()
py = GhPythonScript()  # -> WEB, DATA
# ---------- py: Python ----------
import sys
import os

filepath = os.path.dirname(ghenv.Component.OnPingDocument().FilePath)

LIB = os.path.join(filepath, "..", "src")
LIB = os.path.abspath(LIB)

sys.path.append(LIB)

from workshop_sjsu import DATA
from workshop_sjsu import WEB
# ---------- end py ----------
panel = Panel("1.a) Define planar curve/s")
panel_2 = Panel("1.b) Run simulation")
py_2 = PythonScript(reload=reload)
# ---------- py_2: Python ----------
if reload:
    from compas_ghpython import unload_modules
    unload_modules('compas')
    unload_modules('workshop_sjsu')
    unload_modules('compas_fab')
# ---------- end py_2 ----------

# ----
# Parameters
panel_3 = Panel("polyline curve")
count = Slider(20, range=0..100)
increment = Slider(0.03, range=0.001..0.3)
radius = Slider(1, range=0..10)
split_length = Slider(2, range=0..10)
curve = Curve(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)

# ---- group: TOGGLE TO RUN SIMULATION
run = Button()

# ----
# Differential growth
explode = Explode(Curve=curve, Recursive=True)  # -> Segments, Vertices
run_2 = Data(run)
count_2 = Number(count)
loop_start = LoopStart(Data=explode.Segments, Count=count_2, Trigger=run_2)  # -> port, Data, Counter
python = PythonScript(Lines=loop_start.Data, splitLength=split_length)  # -> l; inputs Lines: list
# ---------- python: Python ----------
import rhinoscriptsyntax as rs

l = []

for i in range(len(Lines)):
    L=Lines[i]
    if rs.CurveLength(L)> splitLength:
        l.append(rs.AddLine(rs.CurveStartPoint(L),rs.CurveMidPoint(L)))
        l.append(rs.AddLine(rs.CurveMidPoint(L),rs.CurveEndPoint(L)))
    else:
        l.append(L)
# ---------- end python ----------
len = Length(Curve=python)
increment_2 = Number(increment)
equals = Equality(FirstNumber=loop_start.Counter, SecondNumber=count_2)  # -> Equality, Inequality
addition = Addition(A=len, B=increment_2)
end = EndPoints(Curve=python)  # -> Start, End
length_line = LengthLine(Line=python, Length=addition, Strength=1)
sc = SphereCollide(Points=end.Start, Radius=radius, Strength=1)
bool = Boolean([True, False])
solver = Solver(GoalObjects=[sc, length_line], Reset=bool, Threshold=1e-15, Tolerance=0.01, On=equals.Inequality)  # -> I, V, O
simplify = SimplifyTree(Tree=solver.O, Front=False)
branch = TreeBranch(Tree=simplify, Path="{1}", MaintainPaths=True)
shift = ShiftList(List=branch, Shift=1, Wrap=False)
loop_end = LoopEnd(port=loop_start.port, Data=shift, state="Constant output")

# ----
# 2. Press on data dam
dam = DataDam(DataA=loop_end, BufferDelay=10000000, BufferMode=0)
end_2 = EndPoints(Curve=dam)  # -> Start, End
# 3. Define boundary circle
# (increase or decrease radius until it fits)
nurbs = NurbsCurve(Vertices=end_2.Start, Degree=3, Periodic=False)  # -> Curve, Length, Domain

# ----
# Boundary
# Change radius to fit the curve into the circle
number_slider = Slider(19, range=0..100)
xy = XYPlane(Origin=Point(0, 0, 0))
cir = Circle(Plane=xy, Radius=number_slider)
circle = Circle(cir)

# ----
# Resolution
# Define resolution of the curve
number_slider_2 = Slider(100, range=0..400)
divide = DivideCurve(Curve=nurbs.Curve, Count=number_slider_2, Kinks=False)  # -> Points, Tangents, Parameters
pline = PolyLine(Vertices=divide.Points, Closed=False)

# ----
# Gradient
# circle to check if gradient works
python_2 = GhPythonScript(circle=circle, points=divide.Points)  # -> Pn; inputs points: list
# ---------- python_2: Python ----------
import Rhino.Geometry as rg


Pn = []
for point in points:
    if circle.ToNurbsCurve().Contains(point, rg.Plane.WorldXY) == rg.PointContainment.Inside:
        point_new = (point + rg.Vector3d(circle.Radius, circle.Radius, 0))/(2 * circle.Radius)
        Pn.append(point_new)
# ---------- end python_2 ----------
# Create your own or look into workshop_sjsu\images for other gradients.
# ATTENTION: If you create your own, please make them the same size of 100x100 px.
image = ImageSampler(
    python_2,
    FilePath="C:\Users\rustr\workspace\teaching\workshop_sjsu\images\gradient-04.png",
    Filter="Value",
    Interpolate=False,
    Umax=1,
    Umin=0,
    Vmax=1,
    Vmin=0,
    Wrap=1)
cir_2 = Circle(Plane=divide.Points, Radius=image)

# ----
# Sphere
py_3 = GhPythonScript()  # -> sphere; unedited script template
sphere = Geometry(py_3)

# ----
# Map curves on sphere
number_slider_3 = Slider(1, range=0..2)
map = GhPythonScript(P=divide.Points, circle=circle, mult_x=Slider(1, range=0..2), mult_y=number_slider_3)  # -> Puv; inputs P: list
# ---------- map: Python ----------
import math
from compas_fab.utilities import map_range
import Rhino.Geometry as rg

Puv = []

for pt in P:
    u = map_range(pt.X, -circle.Radius * mult_x, circle.Radius * mult_x, math.radians(0), math.radians(360))
    v = map_range(pt.Y, -circle.Radius * mult_y, circle.Radius * mult_y, math.radians(-90), math.radians(90))
    Puv.append(rg.Point3d(u, v, 0))
# ---------- end map ----------
multiplication = Multiplication(A=image, B=Slider(0.006, range=0..0.01))
evalsrf = EvaluateSurface(Surface=sphere, Point=map)  # -> Point, Normal, UDirection, VDirection, Frame
nurbs_2 = NurbsCurve(Vertices=evalsrf.Point, Degree=3, Periodic=False)  # -> Curve, Length, Domain
crv_cp = CurveClosestPoint(Point=evalsrf.Point, Curve=nurbs_2.Curve)  # -> Point, Parameter, Distance
swatch = ColourSwatch(SwatchColor=RGB(0, 255, 123))
vpipe = PipeVariable(Curve=nurbs_2.Curve, Parameters=crv_cp.Parameter, Radii=multiplication, Caps=0)
preview = CustomPreview(Geometry=vpipe, Material=swatch)

# ----
# Export
# 4. Press data dam to convert to mesh, change name if necessary and export for VR viewer
dam_2 = DataDam(DataA=vpipe, BufferDelay=10000000, BufferMode=0)
mesh = MeshBrep(
    Brep=dam_2,
    Settings={GridMaxCount=0, GridMinCount=16, JaggedSeams=False, MaxEdgeLength=0, MinEdgeLength=0.0001, MinTolerance=0, Refine=True, RefineAngle=0, RelativeTolerance=0.65, SimplePlanes=True, Tolerance=0})
python_3 = GhPythonScript(M=mesh, name="example03", color=swatch, write=Button())  # -> out; inputs M: list
# ---------- python_3: Python ----------
from compas_rhino.geometry import RhinoMesh
from workshop_sjsu.glb_viewer import create_glb_viewer
from compas.utilities import color_to_rgb

meshes = [RhinoMesh.from_geometry(m).to_compas() for m in M]

color = color_to_rgb([color.R, color.G, color.B], normalize=True)

if write:
    create_glb_viewer(name, meshes, color)
# ---------- end python_3 ----------
# Run localhost.py and open
# 
# http://127.0.0.1:8000/example03.html
# in your browser
panel_4 = Panel(python_3)
