# Grasshopper definition example02.ghx (Grasshopper 1.0.7)

reload = Button()
py = GhPythonScript()  # -> WEB, DATA
# ---------- py: Python ----------
import sys
import os

filepath = os.path.dirname(ghenv.Component.OnPingDocument().FilePath)

LIB = os.path.join(filepath, "..", "src")
LIB = os.path.abspath(LIB)

sys.path.append(LIB)

from workshop_sjsu import DATA
from workshop_sjsu import WEB
# ---------- end py ----------
panel = Panel("1.a) Define planar curve/s")
panel_2 = Panel("1.b) Run simulation")
py_2 = PythonScript(reload=reload)
# ---------- py_2: Python ----------
if reload:
    from compas_ghpython import unload_modules
    unload_modules('compas')
    unload_modules('workshop_sjsu')
    unload_modules('compas_fab')
# ---------- end py_2 ----------

# ----
# Parameters
number_slider = Slider(0.9, range=0..1)

# ----
# Spirograph
spirograph = GhPythonScript(
    R=number_slider,
    r=Slider(-0.46, range=-2..2),
    d=Slider(-0.98, range=-2..2),
    theta=Slider(0.02, range=0..1),
    steps=Slider(5, range=0..100))  # -> lines
# ---------- spirograph: Python ----------
from math import sin, cos, pi
import Rhino.Geometry as rg


points = [] #empty list to put points in

steps = int(steps * pi /theta)

for t in range(0, steps):
    t *= theta
    x = (R - r) * cos(t) + d * cos(((R-r)/r) * t)
    y = (R - r) * sin(t) - d * sin(((R-r)/r) * t)
    points.append(rg.Point3d(x,y,0))
    
lines = []
for p1, p2 in zip(points[:-1], points[1:]):
    lines.append(rg.Line(p1, p2))
# ---------- end spirograph ----------
join = JoinCurves(Curves=spirograph, Preserve=False)
# 3. Define boundary circle
# (increase or decrease radius until it fits)
crv = Curve(join)
py_3 = GhPythonScript(crv=crv)  # -> P
# ---------- py_3: Python ----------
import rhinoscriptsyntax as rs

P = rs.CurvePoints(crv)
# ---------- end py_3 ----------
pt = Point(py_3)

# ----
# Boundary
# Change radius to fit the curve into the circle
number_slider_2 = Slider(3, range=0..100)
xy = XYPlane(Origin=Point(0, 0, 0))
cir = Circle(Plane=xy, Radius=number_slider_2)
circle = Circle(cir)

# ----
# Sphere
py_4 = GhPythonScript()  # -> sphere; unedited script template
sphere = Geometry(py_4)

number_slider_3 = Slider(0.05, range=0..0.1)

# ----
# Gradient
# circle to check if gradient works
python = GhPythonScript(circle=circle, points=pt)  # -> Pn; inputs points: list
# ---------- python: Python ----------
import Rhino.Geometry as rg


Pn = []
for point in points:
    if circle.ToNurbsCurve().Contains(point, rg.Plane.WorldXY) == rg.PointContainment.Inside:
        point_new = (point + rg.Vector3d(circle.Radius, circle.Radius, 0))/(2 * circle.Radius)
        Pn.append(point_new)
# ---------- end python ----------
# Create your own or look into workshop_sjsu\images for other gradients.
# ATTENTION: If you create your own, please make them the same size of 100x100 px.
image = ImageSampler(
    python,
    FilePath="C:\Users\rustr\workspace\teaching\workshop_sjsu\images\gradient-03.png",
    Filter="Value",
    Interpolate=False,
    Umax=1,
    Umin=0,
    Vmax=1,
    Vmin=0,
    Wrap=1)

multiplication = Multiplication(A=image, B=Slider(0.06, range=0..1))

cir_2 = Circle(Plane=pt, Radius=multiplication)

# ----
# Map curves on sphere
number_slider_4 = Slider(0.6, range=0..2)
map = GhPythonScript(P=pt, circle=circle, mult_x=Slider(2, range=0..2), mult_y=number_slider_4)  # -> Puv; inputs P: list
# ---------- map: Python ----------
import math
from compas_fab.utilities import map_range
import Rhino.Geometry as rg

Puv = []

for pt in P:
    u = map_range(pt.X, -circle.Radius * mult_x, circle.Radius * mult_x, math.radians(0), math.radians(360))
    v = map_range(pt.Y, -circle.Radius * mult_y, circle.Radius * mult_y, math.radians(-90), math.radians(90))
    Puv.append(rg.Point3d(u, v, 0))
# ---------- end map ----------
multiplication_2 = Multiplication(A=image, B=Slider(0.006, range=0..0.01))
evalsrf = EvaluateSurface(Surface=sphere, Point=map)  # -> Point, Normal, UDirection, VDirection, Frame
swatch = ColourSwatch(SwatchColor=RGB(0, 255, 123))

nurbs = NurbsCurve(Vertices=evalsrf.Point, Degree=3, Periodic=False)  # -> Curve, Length, Domain
divide = DivideCurve(Curve=nurbs.Curve, Count=Slider(300, range=0..1000), Kinks=False)  # -> Points, Tangents, Parameters
python_2 = GhPythonScript(t=divide.Parameters, R=Slider(0.002, range=0..0.01))  # -> out, R; inputs t: list
# ---------- python_2: Python ----------
R = [R for _ in range(len(t))]
# ---------- end python_2 ----------

vpipe = PipeVariable(Curve=nurbs.Curve, Parameters=divide.Parameters, Radii=python_2.R, Caps=0)
preview = CustomPreview(Geometry=vpipe, Material=swatch)

# ----
# Export
# 4. Press data dam to convert to mesh, change name if necessary and export for VR viewer
dam = DataDam(DataA=vpipe, BufferDelay=10000000, BufferMode=0)
mesh = MeshBrep(
    Brep=dam,
    Settings={GridMaxCount=0, GridMinCount=16, JaggedSeams=False, MaxEdgeLength=0, MinEdgeLength=0.0001, MinTolerance=0, Refine=True, RefineAngle=0, RelativeTolerance=0.65, SimplePlanes=True, Tolerance=0})

py_5 = GhPythonScript(M=mesh)  # -> meshes; inputs M: list
# ---------- py_5: Python ----------
from compas_rhino.geometry import RhinoMesh

meshes = [RhinoMesh.from_geometry(m).to_compas() for m in M]
# ---------- end py_5 ----------

python_3 = GhPythonScript(meshes=py_5, name="example03", color=swatch, write=Button())  # -> out; inputs meshes: list
# ---------- python_3: Python ----------
from compas_rhino.geometry import RhinoMesh
from workshop_sjsu.glb_viewer import create_glb_viewer
from compas.utilities import color_to_rgb

color = color_to_rgb([color.R, color.G, color.B], normalize=True)

if write:
    create_glb_viewer(name, meshes, color)
# ---------- end python_3 ----------
# Run localhost.py and open
# 
# http://127.0.0.1:8000/example03.html
# in your browser
panel_3 = Panel(python_3)
