# Grasshopper definition example03.ghx (Grasshopper 1.0.7)

reload = Button()
panel = Panel("Example 03: Spiral")
py = GhPythonScript()  # -> WEB, DATA
# ---------- py: Python ----------
import sys
import os

filepath = os.path.dirname(ghenv.Component.OnPingDocument().FilePath)

LIB = os.path.join(filepath, "..", "src")
LIB = os.path.abspath(LIB)

sys.path.append(LIB)

from workshop_sjsu import DATA
from workshop_sjsu import WEB
# ---------- end py ----------

# ----
# 3. Define boundary circle
# (increase or decrease radius until it fits)
number_slider = Slider(0.11, range=0..1)
spiral = GhPythonScript(num=Slider(97, range=0..1000), q=Slider(0.24, range=0..1), factor=number_slider)  # -> pts; inputs num: Int32
# ---------- spiral: Python ----------
import Rhino.Geometry as rg
import math

P = rg.Point3d(0,0,0)
pts = []

start, end = 0, 200





for i in range(num):
    x = P.X + q * i * math.cos(q * i) * factor
    y = P.Y + q * i * math.sin(q * i) * factor
    pts.append(rg.Point3d(x, y, 0))
# ---------- end spiral ----------
nurbs = NurbsCurve(Vertices=spiral, Degree=3, Periodic=False)  # -> Curve, Length, Domain

py_2 = PythonScript(reload=reload)
# ---------- py_2: Python ----------
if reload:
    from compas_ghpython import unload_modules
    unload_modules('compas')
    unload_modules('workshop_sjsu')
    unload_modules('compas_fab')
# ---------- end py_2 ----------
name = Data("example03")

# ----
# Boundary
# Change radius to fit the curve into the circle
number_slider_2 = Slider(2.8, range=0..100)
xy = XYPlane(Origin=Point(0, 0, 0))
cir = Circle(Plane=xy, Radius=number_slider_2)
circle = Circle(cir)

# ----
# Resolution
# Define resolution of the curve, ideally not higher than 1000 points
number_slider_3 = Slider(0.6, range=0.1..20)
py_3 = GhPythonScript(C=nurbs.Curve, N=number_slider_3, circle=circle)  # -> points2d, points2d_n, crv, params
# ---------- py_3: Python ----------
import Rhino.Geometry as rg


params = rg.Curve.DivideByLength(C, N, True)
points2d = [C.PointAt(p) for p in params]

points2d_n = []
for point in points2d:
    point_new = (point + rg.Vector3d(circle.Radius, circle.Radius, 0))/(2 * circle.Radius)
    points2d_n.append(point_new)
    

crv = rg.Curve.CreateControlPointCurve(points2d)
params = [rg.Curve.ClosestPoint(crv, pt)[1] for pt in points2d]
# ---------- end py_3 ----------
pt = Point(py_3.points2d)

# ----
# Gradient
# Color
image = ImageSampler(
    py_3.points2d_n,
    FilePath="C:\Users\rustr\workspace\teaching\workshop_sjsu\images\gradient-05.png",
    Filter="Colour",
    Interpolate=False,
    Umax=1,
    Umin=0,
    Vmax=1,
    Vmin=0,
    Wrap=1)
# Create your own or look into workshop_sjsu\images for other gradients.
# ATTENTION: If you create your own, please make them the same size of 100x100 px.
image_2 = ImageSampler(
    py_3.points2d_n,
    FilePath="C:\Users\rustr\workspace\teaching\workshop_sjsu\images\gradient-02.png",
    Filter="Value",
    Interpolate=False,
    Umax=1,
    Umin=0,
    Vmax=1,
    Vmin=0,
    Wrap=1)
multiplication = Multiplication(A=image_2, B=Slider(0.05, range=0..5))
gradient = Number(image_2)
cloud = CloudDisplay(Points=py_3.points2d, Colours=image, Size=multiplication, SpriteType=0)

dam = DataDam(DataA=gradient, BufferDelay=10000000, BufferMode=0)
dam_2 = DataDam(DataA=py_3.points2d, BufferDelay=10000000, BufferMode=0)

# ----
# Sphere
py_4 = GhPythonScript()  # -> sphere; unedited script template
sphere = Geometry(py_4)
preview = CustomPreview(Geometry=sphere, Material=ColourSwatch(SwatchColor=RGBA(255, 255, 255, 76)))

python = GhPythonScript(sphere=sphere, circle=circle, points2d=dam_2, scale=Slider(1.34, range=0.3..2.5))  # -> P, points3d; inputs sphere: Surface, points2d: list
# ---------- python: Python ----------
from workshop_sjsu.rhino.utilities import map2sphere


points3d = map2sphere(sphere, circle, points2d, scale)
# ---------- end python ----------

# ----
# Map curves on sphere
# change here to scale
points3d = Point(python.points3d)

# ----
# Export for robot
python_2 = GhPythonScript(points3d=points3d, gradients=dam, colors=image)  # -> data; inputs points3d: tree, gradients: tree, colors: tree
# ---------- python_2: Python ----------
from workshop_sjsu.rhino.utilities import format_data_for_export

data = format_data_for_export(points3d, gradients, colors)

data = [data]
# ---------- end python_2 ----------
python_3 = GhPythonScript(DATA=py.DATA, name=name)  # -> filepath
# ---------- python_3: Python ----------
import os

filename = name + ".json"
filepath = os.path.join(DATA, filename)
print filepath
# ---------- end python_3 ----------
to_json = ToJSON(data=python_2, filepath=python_3, pretty=Toggle(True))  # -> json; inputs pretty: Boolean
#   port data: COMPAS data objects to serialize.
#   port filepath: File path where to store the JSON file. If empty, it will not store to disk but instead return the JSON string.
#   port pretty: If True, JSON data will be formatted with indentation and key sorting.
#   port json: JSON file path or JSON string.
# ---------- to_json: Python ----------
"""
Serializes COMPAS objects to JSON.
"""
from ghpythonlib.componentbase import executingcomponent as component

import compas


class CompasInfo(component):
    def RunScript(self, data, filepath, pretty):
        json = filepath

        if filepath:
            compas.json_dump(data, filepath, pretty)
        else:
            json = compas.json_dumps(data, pretty)

        return json
# ---------- end to_json ----------

# ----
# Visualisation
number_slider_4 = Slider(0.014, range=0..0.04)
python_4 = GhPythonScript(points3d=points3d, gradients=dam, scale=Slider(0.008, range=0..0.01))  # -> crv, params, radii; inputs points3d: list, gradients: list
# ---------- python_4: Python ----------
import Rhino.Geometry as rg
import scriptcontext


crv = rg.Curve.CreateControlPointCurve(points3d)
params = [crv.ClosestPoint(pt)[1] for pt in points3d]
radii = [r*scale for r in gradients]
# ---------- end python_4 ----------
vpipe = PipeVariable(Curve=python_4.crv, Parameters=python_4.params, Radii=python_4.radii, Caps=0)  # -> flatten(Pipe)
multiplication_2 = Multiplication(A=image_2, B=number_slider_4)
colour_swatch = ColourSwatch(SwatchColor=RGB(0, 255, 123))
cloud_2 = CloudDisplay(Points=points3d, Colours=image, Size=multiplication_2, SpriteType=0)
preview_2 = CustomPreview(Geometry=vpipe, Material=colour_swatch)

# ----
# Export for view
# This takes some time ...
# 4. Press data dam to convert to mesh and export for html viewer
dam_3 = DataDam(DataA=vpipe, BufferDelay=10000000, BufferMode=0)
mesh = MeshBrep(
    Brep=dam_3,
    Settings={GridMaxCount=0, GridMinCount=16, JaggedSeams=False, MaxEdgeLength=0, MinEdgeLength=0.0001, MinTolerance=0, Refine=True, RefineAngle=0, RelativeTolerance=0.65, SimplePlanes=True, Tolerance=0})

py_5 = GhPythonScript(M=mesh)  # -> meshes; inputs M: list
# ---------- py_5: Python ----------
from workshop_sjsu.glb_viewer import transform_and_process_meshes_for_glb

meshes = transform_and_process_meshes_for_glb(M)
# ---------- end py_5 ----------

python_5 = GhPythonScript(meshes=py_5, name=name, color=colour_swatch, write=Button())  # -> out; inputs meshes: list
# ---------- python_5: Python ----------
from workshop_sjsu.glb_viewer import create_glb_viewer
from compas.utilities import color_to_rgb

color = color_to_rgb([color.R, color.G, color.B], normalize=True)

if write:
    create_glb_viewer(name, meshes, color)
# ---------- end python_5 ----------
# Run
# 
# workshop_sjsu/web/http-file-server.exe
# 
#  and open
# 
# http://localhost:8080/web/example03.html
# 
# in your browser
panel_2 = Panel(python_5)
