# Grasshopper definition setup.ghx (Grasshopper 1.0.7)
# plug-ins: Fologram For Grasshopper Utilities

reload = Button()
py = GhPythonScript()  # -> WEB, DATA
# ---------- py: Python ----------
import sys
import os

filepath = os.path.dirname(ghenv.Component.OnPingDocument().FilePath)

#LIB = os.path.join(filepath, "..", "src")
LIB = os.path.join(filepath, "..", "..")
LIB = os.path.abspath(LIB)
print LIB
sys.path.append(LIB)

from workshop_sjsu import DATA
from workshop_sjsu import WEB
# ---------- end py ----------

# ----
# Sphere
py_2 = GhPythonScript()  # -> SPHERE_CENTER
# ---------- py_2: Python ----------
import Rhino.Geometry as rg


from workshop_sjsu.planning import SPHERE_CENTER
from workshop_sjsu.planning import UP_PLANE
from workshop_sjsu.planning import IK_IDX

from compas_ghpython import draw_points

SPHERE_CENTER = rg.Point3d(*list(SPHERE_CENTER))
# ---------- end py_2 ----------
pt = Point(py_2)
py_3 = GhPythonScript()  # -> sphere; unedited script template
move = Move(Geometry=py_3, Motion=pt)  # -> Geometry, Transform
sphere = Geometry(move.Geometry)
preview = CustomPreview(Geometry=sphere, Material=ColourSwatch(SwatchColor=RGBA(158, 158, 158, 53)))

panel = Panel("2. Run 01_prepare_data_for_execution.py")

# ----
# Robot
load = Button()
python = GhPythonScript(load=load)  # -> robot
# ---------- python: Python ----------
from scriptcontext import sticky as st

import compas

compas.PRECISION = '12f'

from compas_fab.robots.ur5 import Robot
from compas_ghpython.artists import RobotModelArtist


# Store robot in component-based key
robot_key = 'robot_{}'.format(str(ghenv.Component.InstanceGuid))

if robot_key not in st:
    st[robot_key] = None
    

if load:
    ur5 = Robot(load_geometry=True)
    ur5.artist = RobotModelArtist(ur5.model)
    st[robot_key] = ur5

robot = st[robot_key]
# ---------- end python ----------
robot = Data(python)

# ----
# Tool
brep = Brep([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])
rotax = RotateAxis(Geometry=brep, Angle=1.570796327, Axis=Line((0, 0, 0), (0, 0.9573123013, 0)))  # -> Geometry, Transform
attach = BooleanToggle(True)
z_offset = Slider(0.078, range=-0.1..0.2)
mesh = MeshBrep(
    Brep=rotax.Geometry,
    Settings={GridMaxCount=0, GridMinCount=16, JaggedSeams=False, MaxEdgeLength=0, MinEdgeLength=0.0001, MinTolerance=0, Refine=True, RefineAngle=0, RelativeTolerance=0.65, SimplePlanes=True, Tolerance=0})
mjoin = MeshJoin(Meshes=mesh)
attach_tool = GhPythonScript(robot=robot, mesh=mjoin, attached=attach, z_offset=z_offset, name="light_pen")  # -> tool, data
# ---------- attach_tool: Python ----------
import os
from compas.geometry import Frame
from compas.datastructures import Mesh
from compas_fab.robots import PlanningScene
from compas_fab.robots import Tool
from compas_ghpython.artists import MeshArtist

from compas_rhino.geometry import RhinoMesh

# create tool from mesh and frame
mesh = RhinoMesh.from_geometry(mesh).to_compas()

#mesh.to_obj(r"C:\Users\rustr\workspace\teaching\workshop_sjsu\src\workshop_sjsu\data\tool.obj")
frame = Frame([z_offset, 0, 0], [0, 0, 1], [0, 1, 0])
tool = Tool(mesh, frame, name=name)

data = [tool.data]

if robot:
    if attached:
        robot.attach_tool(tool)
    else:
        if robot.attached_tool:
            robot.detach_tool()
# ---------- end attach_tool ----------
cluster = Cluster(filename="tool.json")  # disabled
to_json = ToJSON(data=attach_tool.data, filepath=cluster)  # -> json; inputs pretty: Boolean; disabled
#   port data: COMPAS data objects to serialize.
#   port filepath: File path where to store the JSON file. If empty, it will not store to disk but instead return the JSON string.
#   port pretty: If True, JSON data will be formatted with indentation and key sorting.
#   port json: JSON file path or JSON string.
# ---------- to_json: Python ----------
"""
Serializes COMPAS objects to JSON.
"""
from ghpythonlib.componentbase import executingcomponent as component

import compas


class CompasInfo(component):
    def RunScript(self, data, filepath, pretty):
        json = filepath

        if filepath:
            compas.json_dump(data, filepath, pretty)
        else:
            json = compas.json_dumps(data, pretty)

        return json
# ---------- end to_json ----------

# ----
# Camera
num = Number(1.570796327)
_360_camera = Geometry(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)
move_2 = Move(Geometry=_360_camera, Motion=pt)  # -> Geometry, Transform
xz = XZPlane(Origin=pt)
brep_2 = Brep(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)
rotate = Rotate(Geometry=move_2.Geometry, Angle=num, Plane=xz)  # -> Geometry, Transform
mesh_2 = MeshBrep(
    Brep=brep_2,
    Settings={GridMaxCount=0, GridMinCount=16, JaggedSeams=False, MaxEdgeLength=0, MinEdgeLength=0.0001, MinTolerance=0, Refine=True, RefineAngle=0, RelativeTolerance=0.65, SimplePlanes=True, Tolerance=0})
mesh_3 = MeshBrep(
    Brep=rotate.Geometry,
    Settings={GridMaxCount=0, GridMinCount=16, JaggedSeams=False, MaxEdgeLength=0, MinEdgeLength=0.0001, MinTolerance=0, Refine=True, RefineAngle=0, RelativeTolerance=0.65, SimplePlanes=True, Tolerance=0})
mjoin_2 = MeshJoin(Meshes=flatten([mesh_2, mesh_3]))  # disabled
preview_2 = CustomPreview(Geometry=rotate.Geometry, Material=ColourSwatch(SwatchColor=RGB(0, 0, 0)))
cluster_2 = Cluster_2(M=mjoin_2)  # -> mesh, data; disabled
cluster_3 = Cluster(filename="camera_in_position.json")  # disabled
to_json_2 = ToJSON(data=cluster_2.data, filepath=cluster_3)  # -> json; inputs pretty: Boolean; disabled; same code as to_json

panel_2 = Panel("1. Visualise input")
number_slider = Slider(3, range=1..10)
py_4 = GhPythonScript(i=number_slider)  # -> filename; inputs i: Int32
# ---------- py_4: Python ----------
filename = "example%02d.json" % i
# ---------- end py_4 ----------
panel_3 = Panel(py_4)
python_2 = GhPythonScript(DATA=py.DATA, filename=py_4)  # -> filepath
# ---------- python_2: Python ----------
import os

filepath = os.path.join(DATA, filename)
# ---------- end python_2 ----------
py_5 = GhPythonScript(filepath=python_2)  # -> points3d, gradients, colors, C
# ---------- py_5: Python ----------
import json
from ghpythonlib.treehelpers import list_to_tree
import Rhino.Geometry as rg
from System.Drawing import Color

with open(filepath, "r") as f:
    data = json.load(f)

gradients = data['gradients']
points3d = [[rg.Point3d(*p) for p in pts] for pts in data['points3d']]
colors = data['colors']
C = [[Color.FromArgb(255, 255*r, 255*g, 255*b) for r,g,b in cpath] for cpath in colors]

points3d = list_to_tree(points3d)
gradients = list_to_tree(gradients)

colors = list_to_tree(colors)
C = list_to_tree(C)
# ---------- end py_5 ----------
move_3 = Move(Geometry=py_5.points3d, Motion=pt)  # -> Geometry, Transform
pline = PolyLine(Vertices=move_3.Geometry, Closed=False)
addition = Addition(A=py_5.gradients, B=0.001)
multiplication = Multiplication(A=addition, B=Slider(0.01, range=0..0.01))
cloud = CloudDisplay(Points=move_3.Geometry, Colours=py_5.C, Size=multiplication, SpriteType=0)

# ----
# 3. Load results and run simulation to check
# WHY ARE THE POINTS HERE THE SAME SIZE ??
py_6 = GhPythonScript(i=number_slider)  # -> filename; inputs i: Int32
# ---------- py_6: Python ----------
filename = "example%02d_execution.json" % i
# ---------- end py_6 ----------
panel_4 = Panel(py_6)
python_3 = GhPythonScript(DATA=py.DATA, filename=py_6)  # -> filepath; same code as python_2
py_7 = GhPythonScript(filepath=python_3)  # -> gradients, colors, configurations, C, planes
# ---------- py_7: Python ----------
import compas
from ghpythonlib.treehelpers import list_to_tree
import Rhino.Geometry as rg
from System.Drawing import Color
from compas_ghpython import draw_frame

data = compas.json_load(filepath)

gradients = data['gradients']
frames = data['frames']
colors = data['colors']
configurations = data['configurations']


C = [Color.FromArgb(255, 255*r, 255*g, 255*b) for r,g,b in colors]
planes = [draw_frame(f) for f in frames]
# ---------- end py_7 ----------
addition_2 = Addition(A=py_7.gradients, B=0.001)
multiplication_2 = Multiplication(A=addition_2, B=Slider(0.01, range=0..0.01))
cloud_2 = CloudDisplay(Points=py_7.planes, Colours=py_7.C, Size=multiplication_2, SpriteType=0)

# ----
# TODO: joint values adaption needed for UR (specific)
py_8 = GhPythonScript(configurations=py_7.configurations)  # -> configurations; inputs configurations: list
# ---------- py_8: Python ----------
configurations = configurations
# ---------- end py_8 ----------

# ----
# 4. Generate script and send to robot
# TODO: ur does execute scripts above a certain size: check and adapt
number_slider_2 = Slider(0.1, range=0..0.1)
_9111 = Number(9111)
python_4 = GhPythonScript(
    server_ip="192.168.10.11",
    server_port=_9111,
    configurations=py_8,
    velocity=number_slider_2,
    radius=Slider(0.003, range=0..0.01))  # -> script; inputs server_port: Int32, configurations: list
# ---------- python_4: Python ----------
from workshop_sjsu.ur.generate_script import generate_script

script = generate_script(server_ip, server_port, configurations, velocity, radius)
# ---------- end python_4 ----------
_30002 = Number(30002)
python_5 = GhPythonScript(script=python_4, ur_ip="192.168.10.10", ur_port=_30002, send=Button())  # inputs ur_port: Int32
# ---------- python_5: Python ----------
import socket
import os


def send_script(ur_ip, ur_port, script):
    try:
        s = socket.create_connection((ur_ip, ur_port), timeout=2)
        s.send(script)
        print("Script sent to %s on port %i" % (ur_ip, ur_port))
        s.close()
    except socket.timeout:
        print("UR with ip %s not available on port %i" % (ur_ip, ur_port))
        raise

if send:
    send_script(ur_ip, script)
# ---------- end python_5 ----------

# ----
# TODO: TRAJECTORY HAS JUMPS: DO PATH CHECK and bring joint values "down" if possible
py_9 = GhPythonScript(configurations=py_7.configurations)  # -> trajectory; inputs configurations: list
# ---------- py_9: Python ----------
from compas_fab.robots import JointTrajectoryPoint, JointTrajectory


joint_names = configurations[0].joint_names

jtpts = []
for c in configurations:
    values = [v for v in c.values()]
    jtpt = JointTrajectoryPoint.from_revolute_values(values, joint_names=c.joint_names)
    jtpts.append(jtpt)

trajectory = JointTrajectory(trajectory_points=jtpts, joint_names=joint_names, fraction=None)
# ---------- end py_9 ----------
trajectory_visualize = TrajectoryVisualize(robot=robot, trajectory=py_9)  # -> start_configuration, configurations, fraction, time, planes, P, V, A
#   port group: The planning group for which this trajectory was planned.
#   port trajectory: The calculated trajectory.
#   port start_configuration: The start configuration of the trajectory.
#   port configurations: The full configurations along the trajectory.
#   port fraction: Indicates the fraction of requested trajectory that was calculated, e.g. 1 means the full trajectory was found.
#   port time: The time which is needed to execute that trajectory at full speed.
#   port planes: The planes of the robot's end-effector.
#   port P: The positions along the trajectory
#   port V: The velocities along the trajectory
#   port A: The accelerations along the trajectory
# ---------- trajectory_visualize: Python ----------
"""
Visualizes a trajectory.

COMPAS FAB v0.19.1
"""
from compas_ghpython import draw_frame
from compas_ghpython import list_to_ghtree
from ghpythonlib.componentbase import executingcomponent as component


class TrajectoryVisualize(component):
    def RunScript(self, robot, group, trajectory):
        start_configuration = None
        configurations = []
        fraction = 0.
        time = 0.

        planes = []
        positions = []
        velocities = []
        accelerations = []

        if robot and trajectory:
            group = group or robot.main_group_name

            for c in trajectory.points:
                configurations.append(robot.merge_group_with_full_configuration(c, trajectory.start_configuration, group))
                frame = robot.forward_kinematics(c, group, options=dict(solver='model'))
                planes.append(draw_frame(frame))
                positions.append(c.positions)
                velocities.append(c.velocities)
                accelerations.append(c.accelerations)

            start_configuration = trajectory.start_configuration
            fraction = trajectory.fraction
            time = trajectory.time_from_start

        P = list_to_ghtree(list(zip(*positions)))
        V = list_to_ghtree(list(zip(*velocities)))
        A = list_to_ghtree(list(zip(*accelerations)))

        # return outputs if you have them; here I try it for you:
        return (start_configuration, configurations, fraction, time, planes, P, V, A)
# ---------- end trajectory_visualize ----------
graph = QuickGraph(trajectory_visualize.P, SortOrder=0)

py_10 = PythonScript(reload=reload)
# ---------- py_10: Python ----------
if reload:
    from compas_ghpython import unload_modules
    unload_modules('compas')
    unload_modules('workshop_sjsu')
    unload_modules('compas_fab')
# ---------- end py_10 ----------

trigger = Trigger(Interval=1, TimerInterval=5, Target=C)  # disabled
C = Counter(Reset=Button())
item = ListItem(List=py_7.configurations, Index=C, Wrap=True)
panel_5 = Panel(C)

# ---- group: forward kinematics
# Configuration
a2 = Slider(-23, range=-360..360)
a4 = Slider(-90, range=-360..360)
a5 = Slider(-90, range=-360..360)
a1 = Slider(-93, range=-360..360)
a3 = Slider(0, range=-360..360)
a6 = Slider(0, range=-360..360)
forward_kinematics = PythonScript(robot=robot, a1=a1, a2=a2, a3=a3, a4=a4, a5=a5, a6=a6)  # -> configuration
# ---------- forward_kinematics: Python ----------
import math
from compas.robots import Configuration

if robot:
    joint_values = [a1, a2, a3, a4, a5, a6]
    joint_names = robot.get_configurable_joint_names()
    configuration = Configuration.from_revolute_values([math.radians(a) for a in joint_values])
# ---------- end forward_kinematics ----------

# ----
list = ValueList({"0", "1", "2", "3"}, selected="1")
filter = StreamFilter(Gate=list, Stream0=forward_kinematics, Stream1=item)

# ----
# Visualisation
show_end_effector_frame = BooleanToggle(True)
show_base_frame = BooleanToggle(False)
show_collision = BooleanToggle(False)
show_frames = BooleanToggle(False)
show_visual = BooleanToggle(True)
show_acm = BooleanToggle(True)
robot_visualize = RobotVisualize(
    robot=robot,
    configuration=filter,
    show_visual=show_visual,
    show_collision=show_collision,
    show_frames=show_frames,
    show_base_frame=show_base_frame,
    show_end_effector_frame=show_end_effector_frame,
    show_acm=show_acm)  # -> visual, collision, attached_meshes, frames, base_frame, ee_frame; inputs attached_collision_meshes: list, show_visual: Boolean, show_collision: Boolean, show_frames: Boolean, show_base_frame: Boolean, show_end_effector_frame: Boolean, show_acm: Boolean
#   port group: The planning group used for end-effector and base visualization.
#   port configuration: The robot's full configuration.
#   port attached_collision_meshes: A list of attached collision meshes.
#   port show_visual: Whether or not to show the robot's visual meshes.
#   port show_collision: Whether or not to show the robot's collision meshes.
#   port show_frames: Whether or not to show the robot's joint frames.
#   port show_base_frame: Whether or not to show the robot's base frame.
#   port show_end_effector_frame: Whether or not to show the robot's end-effector frame.
#   port show_acm: Whether or not to show the attached collision meshes (if any).
#   port visual: The robot's visual Rhino meshes (if any).
#   port collision: The robot's collision Rhino meshes (if any).
#   port attached_meshes: The attached collision Rhino meshes (if any).
#   port frames: The robot's joint frames as Rhino planes (if any).
#   port base_frame: The robot's base frame as a Rhino plane (if any).
#   port ee_frame: The robot's end-effector frame as a Rhino plane (if any).
# ---------- robot_visualize: Python ----------
"""
Visualizes the robot.

COMPAS FAB v0.19.1
"""
from compas.geometry import Frame
from compas.geometry import Transformation
from compas_ghpython.artists import FrameArtist
from compas_ghpython.artists import MeshArtist
from ghpythonlib.componentbase import executingcomponent as component


class RobotVisualize(component):
    def RunScript(self, robot, group, configuration, attached_collision_meshes, show_visual, show_collision,
                  show_frames, show_base_frame, show_end_effector_frame, show_acm):

        visual = None
        collision = None
        attached_meshes = None
        frames = None
        base_frame = None
        ee_frame = None

        if robot:
            show_visual = True if show_visual is None else show_visual
            configuration = configuration or robot.zero_configuration()

            robot.update(configuration, visual=show_visual, collision=show_collision)
            compas_frames = robot.transformed_frames(configuration, group)

            if show_visual:
                visual = robot.artist.draw_visual()

            if show_collision:
                collision = robot.artist.draw_collision()

            if show_base_frame:
                base_compas_frame = compas_frames[0]
                artist = FrameArtist(base_compas_frame)
                base_frame = artist.draw()

            if show_end_effector_frame:
                ee_compas_frame = robot.forward_kinematics(configuration, group, options=dict(solver='model'))
                artist = FrameArtist(ee_compas_frame)
                ee_frame = artist.draw()

            if show_frames:
                frames = []
                for compas_frame in compas_frames[1:]:
                    artist = FrameArtist(compas_frame)
                    frame = artist.draw()
                    frames.append(frame)

            if show_acm:
                attached_meshes = []
                for acm in attached_collision_meshes:
                    frame = robot.forward_kinematics(configuration, options=dict(solver='model', link_name=acm.link_name))
                    T = Transformation.from_frame_to_frame(Frame.worldXY(), frame)
                    mesh = acm.collision_mesh.mesh.transformed(T)
                    attached_meshes.append(MeshArtist(mesh).draw())

        return (visual, collision, attached_meshes, frames, base_frame, ee_frame)
# ---------- end robot_visualize ----------
geo = Geometry(robot_visualize.collision)
geo_2 = Geometry(robot_visualize.visual)
draw = GhPythonScript(
    frames=flatten([robot_visualize.frames, robot_visualize.base_frame, robot_visualize.ee_frame]),
    scale=Slider(0.1, range=0..1))  # -> P, V, C, W; inputs frames: list
# ---------- draw: Python ----------
from System.Drawing import Color
from compas_ghpython.utilities import draw_frame

red = Color.FromArgb(255, 0, 0)
green = Color.FromArgb(0, 255, 0)
blue = Color.FromArgb(0, 0, 255)

P = []
V = []
C = []

scale = float(scale)

for frame in frames:
    if not frame:
        continue
    plane = frame
    P += [plane.Origin] * 3
    V.append(plane.XAxis * scale)
    V.append(plane.YAxis * scale)
    V.append(plane.ZAxis * scale)
    C += [red, green, blue]

W = 3
# ---------- end draw ----------
item_2 = ListItem(List=geo_2, Index=[0, 1, 2, 3, 4, 5, 6], Wrap=True)
item_3 = ListItem(List=geo_2, Index=7, Wrap=True)
preview_3 = CustomPreview(Geometry=item_3, Material=ColourSwatch(SwatchColor=RGB(0, 0, 0)))
preview_4 = CustomPreview(Geometry=item_2, Material=ColourSwatch(SwatchColor=RGB(255, 255, 255)))
vdisex = VectorDisplayEx(Point=draw.P, Vector=draw.V, Colour=draw.C, Width=draw.W)

# ==== cluster Cluster
filename = ClusterInput()
python = GhPythonScript(filename=filename)  # -> filepath
# ---------- python: Python ----------
import os
from workshop_sjsu import DATA

filepath = os.path.join(DATA, filename)
# ---------- end python ----------
filepath = ClusterOutput(python)

# ==== cluster Cluster_2
M = ClusterInput()
py = GhPythonScript(M=M)  # -> mesh, data
# ---------- py: Python ----------
from compas_rhino.geometry import RhinoMesh

mesh = RhinoMesh.from_geometry(M).to_compas()
data = [mesh.data]
# ---------- end py ----------
mesh = ClusterOutput(py.mesh)
data = ClusterOutput(py.data)
