# Grasshopper definition setup_new.ghx (Grasshopper 1.0.7)
# plug-ins: Fologram For Grasshopper Utilities

number_slider = Slider(0.07, range=0..0.1)
number_slider_2 = Slider(0.07, range=0..0.1)
z_offset = Slider(0.078, range=-0.1..0.2)
measurement_point = Point(Point(0.407143, 0, 0.378667))
panel = Panel("TODO: split possibility")
panel_2 = Panel("70")
addition = Addition(A=z_offset, B=Slider(0, range=0..0.1))
reload = Button()
py = GhPythonScript(reload=reload)  # -> WEB, DATA
# ---------- py: Python ----------
import sys
import os

filepath = os.path.dirname(ghenv.Component.OnPingDocument().FilePath)

LIB = os.path.join(filepath, "..", "src")
LIB = os.path.abspath(LIB)
print LIB
sys.path.append(LIB)

from workshop_sjsu import DATA
from workshop_sjsu import WEB
# ---------- end py ----------
reload_2 = Button()

# ----
# Sphere
py_2 = GhPythonScript()  # -> SPHERE_CENTER
# ---------- py_2: Python ----------
import Rhino.Geometry as rg


from workshop_sjsu.planning import SPHERE_CENTER
from workshop_sjsu.planning import UP_PLANE
from workshop_sjsu.planning import IK_IDX

from compas_ghpython import draw_points

SPHERE_CENTER = rg.Point3d(*list(SPHERE_CENTER))
# ---------- end py_2 ----------
py_3 = GhPythonScript()  # -> sphere; unedited script template
pt = Point(py_2)
move = Move(Geometry=py_3, Motion=pt)  # -> Geometry, Transform
sphere = Geometry(move.Geometry)
preview = CustomPreview(Geometry=sphere, Material=ColourSwatch(SwatchColor=RGBA(158, 158, 158, 53)))

# ----
# Robot
load = Button()
py_4 = GhPythonScript(load=load)  # -> robot
# ---------- py_4: Python ----------
from scriptcontext import sticky as st
from compas_ghpython.artists import RobotModelArtist

from workshop_sjsu.planning.setup import UR5e


# Store robot in component-based key
robot_key = 'robot_{}'.format(str(ghenv.Component.InstanceGuid))

if robot_key not in st:
    st[robot_key] = None
    

if load:
    ur5e = UR5e()
    ur5e.artist = RobotModelArtist(ur5e.model)
    st[robot_key] = ur5e

robot = st[robot_key]
# ---------- end py_4 ----------
robot = Data(py_4)

python = GhPythonScript(robot=robot, point=measurement_point)  # -> configuration
# ---------- python: Python ----------
from compas.geometry import Frame, Plane
from workshop_sjsu.ur.kinematics.analytical_inverse_kinematics import UR5eAnalyticalIK
from workshop_sjsu.planning.constants import IK_IDX
import math
import Rhino.Geometry as rg

kinematics = UR5eAnalyticalIK()

frame = Frame.from_plane(Plane(point, (0, 0, 1)))
frame0_t0cf = robot.attached_tool.from_tcf_to_t0cf([frame])[0]

solutions = kinematics.inverse_kinematics(robot, frame0_t0cf, None)
configuration = solutions[IK_IDX]

new = []
for c1 in configuration.joint_values:
    c2 = c1 - 2 * math.pi
    c3 = c1 + 2 * math.pi
    values = [c1, c2, c3]
    absv = [abs(v) for v in values]
    idx = absv.index(min(absv))
    new.append(values[idx])

configuration.joint_values = new

print [math.degrees(v) for v in configuration.joint_values]

print configuration
# ---------- end python ----------

# ----
# Tool
brep = Brep([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])
z_offset_2 = Slider(0.078, range=-0.1..0.2)
rotax = RotateAxis(Geometry=brep, Angle=1.570796327, Axis=Line((0, 0, 0), (0, 0.9573123013, 0)))  # -> Geometry, Transform
attach = BooleanToggle(True)
mesh = MeshBrep(
    Brep=rotax.Geometry,
    Settings={GridMaxCount=0, GridMinCount=16, JaggedSeams=False, MaxEdgeLength=0, MinEdgeLength=0.0001, MinTolerance=0, Refine=True, RefineAngle=0, RelativeTolerance=0.65, SimplePlanes=True, Tolerance=0})
mjoin = MeshJoin(Meshes=mesh)
attach_tool = GhPythonScript(robot=robot, mesh=mjoin, attached=attach, z_offset=addition, name="light_pen")  # -> tool, data
# ---------- attach_tool: Python ----------
import os
from compas.geometry import Frame
from compas.datastructures import Mesh
from compas_fab.robots import PlanningScene
from compas_fab.robots import Tool
from compas_ghpython.artists import MeshArtist

from compas_rhino.geometry import RhinoMesh

# create tool from mesh and frame
mesh = RhinoMesh.from_geometry(mesh).to_compas()

#mesh.to_obj(r"C:\Users\rustr\workspace\teaching\workshop_sjsu\src\workshop_sjsu\data\tool.obj")
frame = Frame([z_offset, 0, 0], [0, 0, 1], [0, 1, 0])
tool = Tool(mesh, frame, name=name)

data = [tool.data]

if robot:
    if attached:
        robot.attach_tool(tool)
    else:
        if robot.attached_tool:
            robot.detach_tool()
# ---------- end attach_tool ----------
cluster = Cluster(filename="tool.json")
to_json = ToJSON(data=attach_tool.data, filepath=cluster)  # -> json; inputs pretty: Boolean
#   port data: COMPAS data objects to serialize.
#   port filepath: File path where to store the JSON file. If empty, it will not store to disk but instead return the JSON string.
#   port pretty: If True, JSON data will be formatted with indentation and key sorting.
#   port json: JSON file path or JSON string.
# ---------- to_json: Python ----------
"""
Serializes COMPAS objects to JSON.
"""
from ghpythonlib.componentbase import executingcomponent as component

import compas


class CompasInfo(component):
    def RunScript(self, data, filepath, pretty):
        json = filepath

        if filepath:
            compas.json_dump(data, filepath, pretty)
        else:
            json = compas.json_dumps(data, pretty)

        return json
# ---------- end to_json ----------

# ----
# Camera
num = Number(1.570796327)
_360_camera = Geometry(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)
move_2 = Move(Geometry=_360_camera, Motion=pt)  # -> Geometry, Transform
xz = XZPlane(Origin=pt)
brep_2 = Brep(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)
rotate = Rotate(Geometry=move_2.Geometry, Angle=num, Plane=xz)  # -> Geometry, Transform
mesh_2 = MeshBrep(
    Brep=brep_2,
    Settings={GridMaxCount=0, GridMinCount=16, JaggedSeams=False, MaxEdgeLength=0, MinEdgeLength=0.0001, MinTolerance=0, Refine=True, RefineAngle=0, RelativeTolerance=0.65, SimplePlanes=True, Tolerance=0})
mesh_3 = MeshBrep(
    Brep=rotate.Geometry,
    Settings={GridMaxCount=0, GridMinCount=16, JaggedSeams=False, MaxEdgeLength=0, MinEdgeLength=0.0001, MinTolerance=0, Refine=True, RefineAngle=0, RelativeTolerance=0.65, SimplePlanes=True, Tolerance=0})
mjoin_2 = MeshJoin(Meshes=flatten([mesh_2, mesh_3]))  # disabled
preview_2 = CustomPreview(Geometry=rotate.Geometry, Material=ColourSwatch(SwatchColor=RGB(0, 0, 0)))
cluster_2 = Cluster_2(M=mesh_3)  # -> mesh, data; disabled
cluster_3 = Cluster(filename="camera_in_position.json")  # disabled
to_json_2 = ToJSON(data=cluster_2.data, filepath=cluster_3)  # -> json; inputs pretty: Boolean; disabled; same code as to_json

panel_3 = Panel("Milvia.json")
panel_4 = Panel("Kayla.json")
# Juan Zavala Path.json
panel_5 = Panel("Juan_2.json")
panel_6 = Panel("2. Run 01_prepare_data_for_execution.py")
panel_7 = Panel("5. Measure in")
py_5 = PythonScript(reload=reload_2)
# ---------- py_5: Python ----------
if reload:
    from compas_ghpython import unload_modules
    unload_modules('compas')
    unload_modules('workshop_sjsu')
    unload_modules('compas_fab')
# ---------- end py_5 ----------

# ----
# 4. Generate script and send to robot
# TODO: ur does execute scripts above a certain size: check and adapt
panel_8 = Panel("10.0.0.99")
_9111 = Number(9111)

# ----
# have gradient scaling in grasshopper defined => read in from proxy
number_slider_3 = Slider(0.152, range=0..1)
py_6 = GhPythonScript()  # -> SPHERE_CENTER
# ---------- py_6: Python ----------
import Rhino.Geometry as rg
from workshop_sjsu.planning import SPHERE_CENTER

SPHERE_CENTER = rg.Point3d(*list(SPHERE_CENTER))
# ---------- end py_6 ----------
vec = VectorXYZ(XComponent=0, YComponent=0, ZComponent=number_slider_3)  # -> Vector, Length
addition_2 = Addition(A=py_6, B=vec.Vector)
measurement_point_2 = Point(addition_2)
python_2 = GhPythonScript(robot=robot, point=addition_2)  # -> script
# ---------- python_2: Python ----------
from compas.geometry import Frame, Plane
from workshop_sjsu.ur.kinematics.analytical_inverse_kinematics import UR5AnalyticalIK
from workshop_sjsu.planning.constants import IK_IDX
import math
from compas.geometry import Rotation

kinematics = UR5AnalyticalIK()

frame = Frame.from_plane(Plane(point, (0,0,1)))
frame0_t0cf = robot.attached_tool.from_tcf_to_t0cf([frame])[0]

print frame0_t0cf

R = Rotation.from_axis_and_angle([0,0,1], math.radians(180))

point = frame0_t0cf.point.transformed(R)

print list(point)
pose = list(point) + [-math.pi, 0, 0]

tcp=[0, 0, 0, 0, 0, 0]
velocity = 0.1

script = ""
script += "def program():\n"
script += "\ttextmsg(\">> Entering program.\")\n"
script += "\tset_tcp(p%s)\n" % tcp

script += "\tmovel(p[%.6f, %.6f, %.6f, %.6f, %.6f, %.6f], v=%.4f)\n" % tuple(pose + [velocity])

script += "\ttextmsg(\"<< Exiting program.\")\n"
script += "end\n"
script += "program()\n\n\n"
# ---------- end python_2 ----------
python_3 = GhPythonScript(robot=robot, point=measurement_point_2)  # -> out, configuration, P; same code as python
pt_2 = Point(python_3.P)
panel_9 = Panel(python_3.out)
python_4 = GhPythonScript(script=python_2, ur_ip="10.0.0.10", send=Button())  # inputs ur_port: Int32
# ---------- python_4: Python ----------
import socket
import os


def send_script(ur_ip, ur_port, script):
    try:
        s = socket.create_connection((ur_ip, ur_port), timeout=2)
        s.send(script)
        print("Script sent to %s on port %i" % (ur_ip, ur_port))
        s.close()
    except socket.timeout:
        print("UR with ip %s not available on port %i" % (ur_ip, ur_port))
        raise

if send:
    send_script(ur_ip, ur_port, script)
# ---------- end python_4 ----------

filename = Text("compas-logo.json")

panel_10 = Panel("1. Visualise input")
py_7 = GhPythonScript(filename=filename, bang=Toggle(True))  # -> filepath; same code as python
py_8 = GhPythonScript(filepath=py_7)  # -> frames, points3d, gradients, colors, C
# ---------- py_8: Python ----------
import json
from ghpythonlib.treehelpers import list_to_tree
import Rhino.Geometry as rg
from System.Drawing import Color

from workshop_sjsu.planning.utilities import translate_and_create_frames

with open(filepath, "r") as f:
    data = json.load(f)

gradients = data['gradients']

frames = translate_and_create_frames(data['points3d'])
points3d = [[rg.Point3d(*list(frame.point)) for frame in frames_per_path] for frames_per_path in frames]

colors = data['colors']
C = [[Color.FromArgb(255, 255*r, 255*g, 255*b) for r,g,b in cpath] for cpath in colors]

points3d = list_to_tree(points3d)
gradients = list_to_tree(gradients)

colors = list_to_tree(colors)
C = list_to_tree(C)
# ---------- end py_8 ----------
pline = PolyLine(Vertices=py_8.points3d, Closed=False)
addition_3 = Addition(A=py_8.gradients, B=0.001)
multiplication = Multiplication(A=addition_3, B=Slider(0.01, range=0..0.01))
cloud = CloudDisplay(Points=py_8.points3d, Colours=py_8.C, Size=multiplication, SpriteType=0)

py_9 = GhPythonScript(filename=filename)  # -> filename_execution
# ---------- py_9: Python ----------
import os

name, ending = os.path.splitext(filename)

filename_execution = name + "_execution" + ending
# ---------- end py_9 ----------

# ----
# Modifications to make the paths reachable
# Rotate and (scale)?
number_slider_4 = Slider(72, range=-180..180)
python_5 = GhPythonScript(sphere=sphere, filepath=py_7, points3d=py_8.points3d, angle=number_slider_4)  # -> points3d_rotated, rotation; inputs points3d: tree
# ---------- python_5: Python ----------
from workshop_sjsu.rhino.constants import sphere
import Rhino.Geometry as rg
import math
from compas.geometry import Rotation, Point
from workshop_sjsu.planning.constants import SPHERE_CENTER
from ghpythonlib.treehelpers import list_to_tree

rotation = Rotation.from_axis_and_angle((0,0,1), math.radians(angle), list(SPHERE_CENTER))


def polar_to_cartesian(rho, phi):
    x = rho * math.cos(phi)
    y = rho * math.sin(phi)
    return(x, y)

def map_from_sphere_to_circle(sphere, circle, point):
    
    ok, u, v = sphere.ClosestPoint(point)
    
    # isocurve
    crv = sphere.IsoCurve(1, u)
    print u, v
    rho = 0
    x, y = polar_to_cartesian(rho, phi)
    """
    

    rho, phi = cartesian_to_polar(pt2d.X, pt2d.Y)
    crv = sphere.IsoCurve(1, phi)
    rho_mapped = map_range(rho, 0, circle.Radius, -math.pi/2, math.pi/2 - scale)
    
    pt3d = crv.PointAt(rho_mapped)
    points3d.append(pt3d)
    """
    

circle = None 

points3d_rotated = []
for i in range(points3d.BranchCount):
    path = points3d.Path(i)
    alist = list(points3d.Branch(path))
    for p in alist:
        
        map_from_sphere_to_circle(sphere, circle, p)
        """
        pc = Point(*list(p))
        pc.transform(rotation)
        pr = rg.Point3d(*list(pc))
        points3d_rotated[-1].append(pr)
        """

points3d_rotated = list_to_tree(points3d_rotated)
# ---------- end python_5 ----------
json = GhPythonScript(angle=number_slider_4, filepath=py_7, pretty=Toggle(True), write=Button())
# ---------- json: Python ----------
import json
import compas
import math
from compas.geometry import Point
from compas.geometry import Rotation

rotation = Rotation.from_axis_and_angle((0,0,1), math.radians(angle), (0,0,0))

with open(filepath, "r") as f:
    data = json.load(f)

for i, points_per_path in enumerate(data['points3d']):
    for j, point in enumerate(points_per_path):
        p = Point(*point)
        p.transform(rotation)
        data['points3d'][i][j] = list(p)

if filepath and write:
    compas.json_dump(data, filepath, pretty)
# ---------- end json ----------

python_6 = GhPythonScript(filepath=py_7, points3d=py_8.points3d, index=Slider(3, range=0..10))  # -> points3d_rotated, rotation; inputs points3d: tree
# ---------- python_6: Python ----------
from workshop_sjsu.rhino.constants import sphere
import Rhino.Geometry as rg
import math
from compas.geometry import Rotation, Point
from workshop_sjsu.planning.constants import SPHERE_CENTER
from ghpythonlib.treehelpers import list_to_tree

rotation = Rotation.from_axis_and_angle((0,0,1), math.radians(angle), list(SPHERE_CENTER))

points3d_rotated = []
#for i in range(points3d.BranchCount):
i = index 
path = points3d.Path(i)
alist = list(points3d.Branch(path))

for p in alist:
    print type(p)
    pc = Point(*list(p))
    pc.transform(rotation)
    pr = rg.Point3d(*list(pc))
    points3d_rotated[-1].append(pr)

points3d_rotated = list_to_tree(points3d_rotated)
# ---------- end python_6 ----------

# ----
# 3. Load results and run simulation to check
py_10 = GhPythonScript(filename=py_9, bang=Toggle(False))  # -> filepath; same code as python
py_11 = GhPythonScript(filepath=py_10)  # -> gradients, colors, configurations, C, planes
# ---------- py_11: Python ----------
import compas
from ghpythonlib.treehelpers import list_to_tree
import Rhino.Geometry as rg
from System.Drawing import Color
from compas_ghpython import draw_frame

data = compas.json_load(filepath)

gradients = data['gradients']
frames = data['frames']
colors = data['colors']
configurations = data['configurations']


C = [Color.FromArgb(255, 255*r, 255*g, 255*b) for r,g,b in colors]
planes = [draw_frame(f) for f in frames]
# ---------- end py_11 ----------
save_pointer = GhPythonScript(filepath=py_10)  # -> out, a
# ---------- save_pointer: Python ----------
import os
from workshop_sjsu import DATA

filename = 'current_file.txt'
with open(os.path.join(DATA, filename), 'w') as f:
    f.write(filepath)
# ---------- end save_pointer ----------
addition_4 = Addition(A=py_11.gradients, B=0.001)
multiplication_2 = Multiplication(A=addition_4, B=Slider(0.01, range=0..0.01))
cloud_2 = CloudDisplay(Points=py_11.planes, Colours=py_11.C, Size=multiplication_2, SpriteType=0)

# ----
# TODO: joint values adaption needed for UR (specific)
py_12 = GhPythonScript(configurations=py_11.configurations)  # -> configurations; inputs configurations: list
# ---------- py_12: Python ----------
import math

configurations = configurations
"""
new_configurations = []

for config in configurations:
    c = config.copy()
    #c.joint_values[0] += math.radians(180)
    c.joint_values[2] += 2 * math.pi
    new_configurations.append(c)

configurations = new_configurations
"""
# ---------- end py_12 ----------

panel_11 = Panel("4. Send first configuration")
item = ListItem(List=py_12, Index=0, Wrap=True)

data = Data(flatten([python, item]))

py_13 = GhPythonScript(configurations=py_11.configurations)  # -> trajectory; inputs configurations: list
# ---------- py_13: Python ----------
from compas_fab.robots import JointTrajectoryPoint, JointTrajectory


joint_names = configurations[0].joint_names

jtpts = []
for c in configurations:
    values = [v for v in c.values()]
    jtpt = JointTrajectoryPoint.from_revolute_values(values, joint_names=c.joint_names)
    jtpts.append(jtpt)

trajectory = JointTrajectory(trajectory_points=jtpts, joint_names=joint_names, fraction=None)
# ---------- end py_13 ----------
trajectory_visualize = TrajectoryVisualize(robot=robot, trajectory=py_13)  # -> start_configuration, configurations, fraction, time, planes, P, V, A
#   port group: The planning group for which this trajectory was planned.
#   port trajectory: The calculated trajectory.
#   port start_configuration: The start configuration of the trajectory.
#   port configurations: The full configurations along the trajectory.
#   port fraction: Indicates the fraction of requested trajectory that was calculated, e.g. 1 means the full trajectory was found.
#   port time: The time which is needed to execute that trajectory at full speed.
#   port planes: The planes of the robot's end-effector.
#   port P: The positions along the trajectory
#   port V: The velocities along the trajectory
#   port A: The accelerations along the trajectory
# ---------- trajectory_visualize: Python ----------
"""
Visualizes a trajectory.

COMPAS FAB v0.19.1
"""
from compas_ghpython import draw_frame
from compas_ghpython import list_to_ghtree
from ghpythonlib.componentbase import executingcomponent as component


class TrajectoryVisualize(component):
    def RunScript(self, robot, group, trajectory):
        start_configuration = None
        configurations = []
        fraction = 0.
        time = 0.

        planes = []
        positions = []
        velocities = []
        accelerations = []

        if robot and trajectory:
            group = group or robot.main_group_name

            for c in trajectory.points:
                configurations.append(robot.merge_group_with_full_configuration(c, trajectory.start_configuration, group))
                frame = robot.forward_kinematics(c, group, options=dict(solver='model'))
                planes.append(draw_frame(frame))
                positions.append(c.positions)
                velocities.append(c.velocities)
                accelerations.append(c.accelerations)

            start_configuration = trajectory.start_configuration
            fraction = trajectory.fraction
            time = trajectory.time_from_start
        
        for i, v in enumerate(list(zip(*positions))):
            print i, min(v), max(v)

        P = list_to_ghtree(list(zip(*positions)))
        V = list_to_ghtree(list(zip(*velocities)))
        A = list_to_ghtree(list(zip(*accelerations)))

        # return outputs if you have them; here I try it for you:
        return (start_configuration, configurations, fraction, time, planes, P, V, A)
# ---------- end trajectory_visualize ----------
graph = QuickGraph(trajectory_visualize.P, SortOrder=0)

urscript = URscript(
    ur_ip="10.0.0.10",
    proxy_ip=panel_8,
    proxy_port=_9111,
    configurations=data,
    velocity=Slider(0.1, range=0..0.1),
    radius=Slider(0.003, range=0..0.01),
    send=Button())
urscript_2 = URscript(
    ur_ip="10.0.0.10",
    proxy_ip=panel_8,
    proxy_port=_9111,
    configurations=py_12,
    velocity=Slider(0.2, range=0..1),
    radius=Slider(0.004, range=0..0.01),
    send=Button())
panel_12 = Panel(urscript)
item_2 = ListItem(List=py_12, Index=0, Wrap=True)
number_slider_5 = Slider(17, range=-100..100)

panel_13 = Panel("2. Check transition paths")
py_14 = GhPythonScript(frames=py_8.frames)  # -> transition_paths; inputs frames: list
# ---------- py_14: Python ----------
import Rhino.Geometry as rg
from ghpythonlib.treehelpers import list_to_tree
from workshop_sjsu.planning.utilities import create_transition_frames_on_sphere


transition_paths = []

for i, (path1, path2) in enumerate(zip(frames[:-1], frames[1:])):
    
    start_frame = path1[-1]
    end_frame = path2[0]

    transition_frames = create_transition_frames_on_sphere(start_frame, end_frame)
    P = [rg.Point3d(*list(frame.point)) for frame in transition_frames]
    transition_paths.append(P)

transition_paths = list_to_tree(transition_paths)
# ---------- end py_14 ----------
pline_2 = PolyLine(Vertices=py_14, Closed=False)

# ----
# Modifications to make the paths reachable
# Rotate and (scale)?
number_slider_6 = Slider(45, range=-180..180)
python_7 = GhPythonScript(filepath=py_7, points3d=py_8.points3d, angle=number_slider_6)  # -> points3d_rotated, rotation; inputs points3d: tree
# ---------- python_7: Python ----------
from workshop_sjsu.rhino.constants import sphere
import Rhino.Geometry as rg
import math
from compas.geometry import Rotation, Point
from workshop_sjsu.planning.constants import SPHERE_CENTER
from ghpythonlib.treehelpers import list_to_tree

rotation = Rotation.from_axis_and_angle((0,0,1), math.radians(angle), list(SPHERE_CENTER))

points3d_rotated = []
for i in range(points3d.BranchCount):
    path = points3d.Path(i)
    alist = list(points3d.Branch(path))
    points3d_rotated.append([])
    for p in alist:
        print type(p)
        pc = Point(*list(p))
        pc.transform(rotation)
        pr = rg.Point3d(*list(pc))
        points3d_rotated[-1].append(pr)

points3d_rotated = list_to_tree(points3d_rotated)
# ---------- end python_7 ----------
json_2 = GhPythonScript(angle=number_slider_6, filepath=py_7, pretty=Toggle(True), write=Button())  # same code as json

# ----
# Modifications to make the paths reachable
# Rotate and (scale)?
python_8 = GhPythonScript(filepath=py_7, points3d=py_8.points3d, angle=number_slider_5)  # -> points3d_rotated, rotation; inputs points3d: tree
# ---------- python_8: Python ----------
from workshop_sjsu.rhino.constants import sphere
import Rhino.Geometry as rg
import math
from compas.geometry import Rotation, Point
from workshop_sjsu.planning.constants import SPHERE_CENTER
from ghpythonlib.treehelpers import list_to_tree

rotation = Rotation.from_axis_and_angle((0,1,0), math.radians(angle), list(SPHERE_CENTER))

points3d_rotated = []
for i in range(points3d.BranchCount):
    path = points3d.Path(i)
    alist = list(points3d.Branch(path))
    points3d_rotated.append([])
    for p in alist:
        print type(p)
        pc = Point(*list(p))
        pc.transform(rotation)
        pr = rg.Point3d(*list(pc))
        points3d_rotated[-1].append(pr)

points3d_rotated = list_to_tree(points3d_rotated)
# ---------- end python_8 ----------
json_3 = GhPythonScript(angle=number_slider_5, filepath=py_7, pretty=Toggle(True), write=Button())
# ---------- json_3: Python ----------
import json
import compas
import math
from compas.geometry import Point
from compas.geometry import Rotation

rotation = Rotation.from_axis_and_angle((0,1,0), math.radians(angle), (0,0,0))

with open(filepath, "r") as f:
    data = json.load(f)

for i, points_per_path in enumerate(data['points3d']):
    for j, point in enumerate(points_per_path):
        p = Point(*point)
        p.transform(rotation)
        data['points3d'][i][j] = list(p)

if filepath and write:
    compas.json_dump(data, filepath, pretty)
# ---------- end json_3 ----------

graph_2 = GraphMapper(x0=0, x1=1, y0=0, y1=1, container_name="Bezier", cpx=[0, 1, 0.753475666, 1], cpy=[0, 0, 1, 1])

trigger = Trigger(Interval=1, TimerInterval=5, Target=C)  # disabled
C = Counter(Reset=Button())
item_3 = ListItem(List=py_11.configurations, Index=C, Wrap=True)
panel_14 = Panel(C)

# ---- group: forward kinematics
# Configuration
a2 = Slider(-103, range=-360..360)
a4 = Slider(-102, range=-360..360)
a5 = Slider(-90, range=-360..360)
a1 = Slider(-19, range=-360..360)
a3 = Slider(103, range=-360..360)
a6 = Slider(-289, range=-360..360)
forward_kinematics = PythonScript(robot=robot, a1=a1, a2=a2, a3=a3, a4=a4, a5=a5, a6=a6)  # -> configuration
# ---------- forward_kinematics: Python ----------
import math
from compas.robots import Configuration

if robot:
    joint_values = [a1, a2, a3, a4, a5, a6]
    joint_names = robot.get_configurable_joint_names()
    configuration = Configuration.from_revolute_values([math.radians(a) for a in joint_values])
# ---------- end forward_kinematics ----------

# ----
python_9 = GhPythonScript(gradient=py_8.gradients)  # -> gradients2; inputs gradient: list
# ---------- python_9: Python ----------
from compas.geometry import Bezier, Point

x = 1.0
y = 1.0
MULT = 0.1
curve = Bezier([[0.0, 0.0, 0.0], [x, 0.0, 0.0], [y, 1.0, 0.0], [1., 1., 0]])

gradients2 = []
for value in gradient:
    v2 = curve.point(value * MULT).y
    #v2 *= 0.8
    gradients2.append(v2)
    

print gradients2
# ---------- end python_9 ----------
graph_3 = QuickGraph(python_9, SortOrder=0)
graph_4 = QuickGraph(py_8.gradients, SortOrder=0)
py_15 = GhPythonScript(configuration=item_3)  # -> configuration
# ---------- py_15: Python ----------
import math

"""
c = configuration.copy()
c.joint_values[2] += 2 * math.pi

configuration = c
"""

configuration = configuration
# ---------- end py_15 ----------
python_10 = GhPythonScript(robot=robot)  # -> out, configuration
# ---------- python_10: Python ----------
from compas.robots import Configuration
import math

if robot:
    joint_values = [0.220754, -1.38913, 1.75562, -4.91736, -1.58675, 0.00723171]
    joint_values = [-0.597134, -1.00831, 1.2349, -0.361401, -1.18018, 0.00754356]
    joint_names = robot.get_configurable_joint_names()
    
    #joint_values[0] -= math.radians(180)
    #joint_values[2] -= 2 * math.pi
    
    configuration = Configuration.from_revolute_values(joint_values)
# ---------- end python_10 ----------
py_16 = GhPythonScript(configurations=py_12)  # -> trajectory; inputs configurations: list; same code as py_13
list = ValueList({"0", "1", "2", "3", "4"}, selected="1")
trajectory_visualize_2 = TrajectoryVisualize(robot=robot, trajectory=py_16)  # -> start_configuration, configurations, fraction, time, planes, P, V, A; same code as trajectory_visualize
filter = StreamFilter(Gate=list, Stream0=forward_kinematics, Stream1=py_15, Stream2=python_10.configuration, Stream3=python_3.configuration)
number_slider_7 = Slider(1, range=0..1)
number_slider_8 = Slider(1, range=0..1)

panel_15 = Panel("Run test_frames_reachable.py")
panel_16 = Panel("REACH")

py_17 = GhPythonScript(filename="frames_reachable_out.json")  # -> filepath; same code as python
py_18 = GhPythonScript(filepath=py_17)  # -> configurations, planes
# ---------- py_18: Python ----------
import compas
from ghpythonlib.treehelpers import list_to_tree
import Rhino.Geometry as rg
from System.Drawing import Color
from compas_ghpython import draw_frame

data = compas.json_load(filepath)

frames = data['frames']
configurations = data['configurations']

planes = [draw_frame(f) for f in frames]
# ---------- end py_18 ----------
pt_3 = Point(py_18.planes)

python_11 = GhPythonScript(sphere=sphere)  # -> out, points; inputs sphere: Surface
# ---------- python_11: Python ----------
def map2sphere(sphere, circle, points2d, scale):
    points3d = []
    for pt2d in points2d:
        rho, phi = cartesian_to_polar(pt2d.X, pt2d.Y)
        crv = sphere.IsoCurve(1, phi)
        rho_mapped = map_range(rho, 0, circle.Radius, -
                               math.pi/2, math.pi/2 - scale)
        pt3d = crv.PointAt(rho_mapped)
        points3d.append(pt3d)
    return points3d


import math
import Rhino.Geometry as rg

print sphere.Domain(0)

curves = []
for angle in range(160, 270, 5):
    print angle
    crv = sphere.IsoCurve(0, math.radians(angle))
    curves.append(crv)


points = []
for crv in curves:
    params = rg.Curve.DivideByLength(crv, 0.01, False)
    points += [crv.PointAt(p) for p in params]
# ---------- end python_11 ----------
py_19 = GhPythonScript(points=python_11.points)  # -> data; inputs points: list
# ---------- py_19: Python ----------
from workshop_sjsu.planning import SPHERE_CENTER
from compas.geometry import Point, Plane, Frame

frames = []

for point in points:
    normal = Point(*list(point)) - SPHERE_CENTER
    plane = Plane(point, normal)
    frame = Frame.from_plane(plane)
    frames.append(frame)

data = frames
# ---------- end py_19 ----------
py_20 = GhPythonScript(filename="frames_reachable_in.json")  # -> filepath; same code as python
to_json_3 = ToJSON(data=py_19, filepath=py_20)  # -> json; inputs data: list, pretty: Boolean; same code as to_json

python_12 = GhPythonScript(configuration=filter)  # -> out, P
# ---------- python_12: Python ----------
from workshop_sjsu.ur.kinematics.offset_wrist_kinematics import UR5e
from compas.geometry import allclose
import Rhino.Geometry as rg

q = configuration.joint_values
kin = UR5e()
frame = kin.forward(q)

 
sol = kin.inverse(frame)

P = rg.Point3d(*list(frame.point))

#assert(allclose(sol[0], q))
# ---------- end python_12 ----------

# ----
# Visualisation
show_end_effector_frame = BooleanToggle(False)
show_base_frame = BooleanToggle(False)
show_collision = BooleanToggle(False)
show_frames = BooleanToggle(False)
show_visual = BooleanToggle(True)
show_acm = BooleanToggle(False)
robot_visualize = RobotVisualize(
    robot=robot,
    configuration=filter,
    show_visual=show_visual,
    show_collision=show_collision,
    show_frames=show_frames,
    show_base_frame=show_base_frame,
    show_end_effector_frame=show_end_effector_frame,
    show_acm=show_acm)  # -> visual, collision, attached_meshes, frames, base_frame, ee_frame; inputs attached_collision_meshes: list, show_visual: Boolean, show_collision: Boolean, show_frames: Boolean, show_base_frame: Boolean, show_end_effector_frame: Boolean, show_acm: Boolean
#   port group: The planning group used for end-effector and base visualization.
#   port configuration: The robot's full configuration.
#   port attached_collision_meshes: A list of attached collision meshes.
#   port show_visual: Whether or not to show the robot's visual meshes.
#   port show_collision: Whether or not to show the robot's collision meshes.
#   port show_frames: Whether or not to show the robot's joint frames.
#   port show_base_frame: Whether or not to show the robot's base frame.
#   port show_end_effector_frame: Whether or not to show the robot's end-effector frame.
#   port show_acm: Whether or not to show the attached collision meshes (if any).
#   port visual: The robot's visual Rhino meshes (if any).
#   port collision: The robot's collision Rhino meshes (if any).
#   port attached_meshes: The attached collision Rhino meshes (if any).
#   port frames: The robot's joint frames as Rhino planes (if any).
#   port base_frame: The robot's base frame as a Rhino plane (if any).
#   port ee_frame: The robot's end-effector frame as a Rhino plane (if any).
# ---------- robot_visualize: Python ----------
"""
Visualizes the robot.

COMPAS FAB v0.19.1
"""
from compas.geometry import Frame
from compas.geometry import Transformation
from compas_ghpython.artists import FrameArtist
from compas_ghpython.artists import MeshArtist
from ghpythonlib.componentbase import executingcomponent as component


class RobotVisualize(component):
    def RunScript(self, robot, group, configuration, attached_collision_meshes, show_visual, show_collision,
                  show_frames, show_base_frame, show_end_effector_frame, show_acm):

        visual = None
        collision = None
        attached_meshes = None
        frames = None
        base_frame = None
        ee_frame = None

        if robot:
            show_visual = True if show_visual is None else show_visual
            configuration = configuration or robot.zero_configuration()

            robot.update(configuration, visual=show_visual, collision=show_collision)
            compas_frames = robot.transformed_frames(configuration, group)

            if show_visual:
                visual = robot.artist.draw_visual()

            if show_collision:
                collision = robot.artist.draw_collision()

            if show_base_frame:
                base_compas_frame = compas_frames[0]
                artist = FrameArtist(base_compas_frame)
                base_frame = artist.draw()

            if show_end_effector_frame:
                ee_compas_frame = robot.forward_kinematics(configuration, group, options=dict(solver='model'))
                artist = FrameArtist(ee_compas_frame)
                ee_frame = artist.draw()

            if show_frames:
                frames = []
                for compas_frame in compas_frames[1:]:
                    artist = FrameArtist(compas_frame)
                    frame = artist.draw()
                    frames.append(frame)

            if show_acm:
                attached_meshes = []
                for acm in attached_collision_meshes:
                    frame = robot.forward_kinematics(configuration, options=dict(solver='model', link_name=acm.link_name))
                    T = Transformation.from_frame_to_frame(Frame.worldXY(), frame)
                    mesh = acm.collision_mesh.mesh.transformed(T)
                    attached_meshes.append(MeshArtist(mesh).draw())

        return (visual, collision, attached_meshes, frames, base_frame, ee_frame)
# ---------- end robot_visualize ----------
geo = Geometry(robot_visualize.visual)
geo_2 = Geometry(robot_visualize.collision)
draw = GhPythonScript(
    frames=flatten([robot_visualize.frames, robot_visualize.base_frame, robot_visualize.ee_frame]),
    scale=Slider(0.1, range=0..1))  # -> P, V, C, W; inputs frames: list
# ---------- draw: Python ----------
from System.Drawing import Color
from compas_ghpython.utilities import draw_frame

red = Color.FromArgb(255, 0, 0)
green = Color.FromArgb(0, 255, 0)
blue = Color.FromArgb(0, 0, 255)

P = []
V = []
C = []

scale = float(scale)

for frame in frames:
    if not frame:
        continue
    plane = frame
    P += [plane.Origin] * 3
    V.append(plane.XAxis * scale)
    V.append(plane.YAxis * scale)
    V.append(plane.ZAxis * scale)
    C += [red, green, blue]

W = 3
# ---------- end draw ----------
item_4 = ListItem(List=geo, Index=[0, 1, 2, 3, 4, 5, 6], Wrap=True)
item_5 = ListItem(List=geo, Index=7, Wrap=True)
preview_3 = CustomPreview(Geometry=item_5, Material=ColourSwatch(SwatchColor=RGB(0, 0, 0)))
preview_4 = CustomPreview(Geometry=item_4, Material=ColourSwatch(SwatchColor=RGB(255, 255, 255)))
vdisex = VectorDisplayEx(Point=draw.P, Vector=draw.V, Colour=draw.C, Width=draw.W)

graph_5 = QuickGraph(trajectory_visualize_2.P, SortOrder=0)
python_13 = GhPythonScript(x=Slider(1, range=0..10), y=Slider(1, range=0..10))  # -> out, P, a
# ---------- python_13: Python ----------
from compas.geometry import Bezier, Point
import Rhino.Geometry as rg

curve = Bezier([[0.0, 0.0, 0.0], [x, 0.0, 0.0], [y, 1.0, 0.0], [1., 1., 0]])

P = []
for t in range(0, 100):
    pt = curve.point(t/100.)
    P.append(rg.Point3d(*list(pt)))
# ---------- end python_13 ----------
pt_4 = Point(python_12.P)
panel_17 = Panel(pt_4)
sph = Sphere(Base=pt_4, Radius=Slider(0.03, range=0..0.1))

# ==== cluster Cluster
filename = ClusterInput()
python = GhPythonScript(filename=filename)  # -> filepath
# ---------- python: Python ----------
import os
from workshop_sjsu import DATA

filepath = os.path.join(DATA, filename)
# ---------- end python ----------
filepath = ClusterOutput(python)

# ==== cluster Cluster_2
M = ClusterInput()
py = GhPythonScript(M=M)  # -> mesh, data
# ---------- py: Python ----------
from compas_rhino.geometry import RhinoMesh

mesh = RhinoMesh.from_geometry(M).to_compas()
data = [mesh.data]
# ---------- end py ----------
mesh = ClusterOutput(py.mesh)
data = ClusterOutput(py.data)

# ==== cluster URscript
ur_ip = ClusterInput()
proxy_ip = ClusterInput()
send = ClusterInput()
proxy_port = ClusterInput()
configurations = ClusterInput()
velocity = ClusterInput()
radius = ClusterInput()
python = GhPythonScript(
    ur_ip=ur_ip,
    proxy_ip=proxy_ip,
    proxy_port=proxy_port,
    configurations=configurations,
    velocity=velocity,
    radius=radius,
    send=send)  # -> script; inputs proxy_port: Int32, configurations: list
# ---------- python: Python ----------
from workshop_sjsu.ur.utilities import URScriptHelper

ur = URScriptHelper(proxy_ip, proxy_port)
script = ur.send_configurations(configurations, velocity=velocity, radius=radius)

if send:
    try:
        sock = ur.execute(ur_ip, script)
    finally:
        sock.close()
# ---------- end python ----------
script = ClusterOutput(python)
